# Grasshopper definition Apple Spiral Staircase - Rhino Grasshopper Script.gh (Grasshopper 1.0.7)

number_of_divisions = Slider(24, range=0..50)
diameter_internal = Slider(100, range=0..300)
width_of_stairs = Slider(100, range=0..200)
floor_height = Slider(400, range=0..700)
number_of_steps = Slider(30, range=0..100)
tread_thickness = Slider(3, range=0..5)
steps_division_for_balustrade = Slider(3, range=0..5)
balustrade_glass_thickness = Slider(2.5, range=0..5)
height_of_handrail = Slider(90, range=0..100)
radius_of_handrail = Slider(4, range=0..6)
radius_of_handrail_support = Slider(3, range=0..3)
radius_of_handrail_support_bracket = Slider(3, range=0..3)
spiral_glass_staircase = SpiralGlassStaircase(
    number_of_divisions=number_of_divisions,
    diameter_internal=diameter_internal,
    width_of_stairs=width_of_stairs,
    floor_height=floor_height,
    number_of_steps=number_of_steps,
    tread_thickness=tread_thickness,
    steps_division=steps_division_for_balustrade,
    balustrade_glass_thickness=balustrade_glass_thickness,
    height_of_handrail=height_of_handrail,
    radius_of_handrail=radius_of_handrail,
    radius_of_handrail_support=radius_of_handrail_support,
    radius_of_handrail_support_bracket=radius_of_handrail_support_bracket)  # -> staircase_treads, balustrade, handrail, brackets

# ==== cluster SpiralGlassStaircase
number_of_divisions = ClusterInput()
diameter_internal = ClusterInput()
width_of_stairs = ClusterInput()
floor_height = ClusterInput()
number_of_steps = ClusterInput()
tread_thickness = ClusterInput()
steps_division = ClusterInput()
balustrade_glass_thickness = ClusterInput()
height_of_handrail = ClusterInput()
radius_of_handrail = ClusterInput()
radius_of_handrail_support = ClusterInput()
radius_of_handrail_support_bracket = ClusterInput()
gap = Slider(2, range=0..10)
offset_from_stair = Slider(2.5, range=0..5)
tread_height = Division(FloorHeight=floor_height, B=number_of_steps)
number_slider = Slider(6, range=0.1..6)
tread_height_2 = Panel(tread_height)
subtraction = Subtraction(A=number_of_steps, B=number_of_divisions)
addition = Addition(A=number_of_steps, B="1")

# ---- group: steps
addition_2 = Addition(A=diameter_internal, B=width_of_stairs)
circle = Circle(Plane=PlaneXY(0, 0, 0), Radius=diameter_internal)
circle_2 = Circle(Plane=PlaneXY(0, 0, 0), Radius=addition_2)
end_points = EndPoints(Curve=circle_2)  # -> Start, End
line = Line(StartPoint=circle, EndPoint=end_points.Start)
division = Division(A="360", B=number_of_divisions)
rotate = Rotate(Geometry=line, Angle=degrees(division), Plane=circle)  # -> Geometry, Transform
angle = Angle(VectorA=line, VectorB=rotate.Geometry)  # -> Angle, Reflex
arc = Arc(Plane=circle, Radius=diameter_internal, Angle=angle.Angle)  # -> Arc, Length
arc_2 = Arc(Plane=circle, Radius=addition_2, Angle=angle.Angle)  # -> Arc, Length
end_points_2 = EndPoints(Curve=arc.Arc)  # -> Start, End
end_points_3 = EndPoints(Curve=arc_2.Arc)  # -> Start, End
line_2 = Line(StartPoint=end_points_2.Start, EndPoint=end_points_3.Start)
line_3 = Line(StartPoint=end_points_3.End, EndPoint=end_points_2.End)
join_curves = JoinCurves(Curves=[arc_2.Arc, line_2, line_3, arc.Arc], Preserve=False)
boundary_surfaces = BoundarySurfaces(Edges=join_curves)
unit_z = UnitZ(Factor=tread_thickness)
extrude = Extrude(Base=boundary_surfaces, Direction=unit_z)
series = Series(Start=0, Step=tread_height, Count=number_of_steps)
series_2 = Series(Start=0, Step=division, Count=number_of_steps)
unit_z_2 = UnitZ(Factor=series)

# ---- group: baluster
negative = Negative(Value=offset_from_stair)
addition_3 = Addition(A=diameter_internal, B=negative)
addition_4 = Addition(A=addition_2, B=offset_from_stair)
arc_3 = Arc(Plane=PlaneXY(0, 0, 0), Radius=addition_3, Angle=angle.Angle)  # -> Arc, Length
arc_4 = Arc(Plane=PlaneXY(0, 0, 0), Radius=addition_4, Angle=angle.Angle)  # -> Arc, Length
end_points_4 = EndPoints(Curve=arc_3.Arc)  # -> Start, End
end_points_5 = EndPoints(Curve=arc_4.Arc)  # -> Start, End
series_3 = Series(Start=0, Step=division, Count=addition)
series_4 = Series(Start=0, Step=division, Count=addition)
rotate_2 = Rotate(Geometry=end_points_4.Start, Angle=degrees(series_3), Plane=PlaneXY(0, 0, 0))  # -> Geometry, Transform
rotate_3 = Rotate(Geometry=end_points_5.Start, Angle=degrees(series_4), Plane=PlaneXY(0, 0, 0))  # -> Geometry, Transform
series_5 = Series(Start=0, Step=tread_height, Count=addition)
unit_z_3 = UnitZ(Factor=series_5)
unit_z_4 = UnitZ(Factor=series_5)
move = Move(Geometry=rotate_3.Geometry, Motion=unit_z_4)  # -> Geometry, Transform
move_2 = Move(Geometry=rotate_2.Geometry, Motion=unit_z_3)  # -> Geometry, Transform
interpolate = Interpolate(Vertices=move_2.Geometry, Degree=3, Periodic=False, KnotStyle=1)  # -> Curve, Length, Domain
interpolate_2 = Interpolate(Vertices=move.Geometry, Degree=3, Periodic=False, KnotStyle=1)  # -> Curve, Length, Domain
negative_2 = Negative(Value=Slider(20, range=1..100))
negative_3 = Negative(Value=Slider(20, range=1..100))
unit_z_5 = UnitZ(Factor=Slider(100, range=1..100))
unit_z_6 = UnitZ(Factor=negative_2)
unit_z_7 = UnitZ(Factor=Slider(100, range=1..100))
unit_z_8 = UnitZ(Factor=negative_3)
move_3 = Move(Geometry=interpolate.Curve, Motion=unit_z_5)  # -> Geometry, Transform
move_4 = Move(Geometry=interpolate.Curve, Motion=unit_z_6)  # -> Geometry, Transform
move_5 = Move(Geometry=interpolate_2.Curve, Motion=unit_z_7)  # -> Geometry, Transform
move_6 = Move(Geometry=interpolate_2.Curve, Motion=unit_z_8)  # -> Geometry, Transform
loft = Loft(
    Curves=[move_3.Geometry, move_4.Geometry],
    Options={Adjust=False, Closed=False, LoftEnds=0, LoftSimp=0, LoftType=0, Rebuild=10, Refit=0.01})
loft_2 = Loft(
    Curves=[move_5.Geometry, move_6.Geometry],
    Options={Adjust=False, Closed=False, LoftEnds=0, LoftSimp=0, LoftType=0, Rebuild=10, Refit=0.01})
entwine = Entwine(Branch00=[move_3.Geometry, move_4.Geometry], Branch01=[move_5.Geometry, move_6.Geometry], FlattenInputs=True)
end_points_6 = EndPoints(Curve=entwine)  # -> Start, End
polyline = PolyLine(Vertices=end_points_6.Start, Closed=False)
rotate_4 = Rotate(Geometry=polyline, Angle=degrees(series_2), Plane=PlaneXY(0, 0, 0))  # -> Geometry, Transform
repeat_data = RepeatData(Data="False", Length=steps_division)
move_7 = Move(Geometry=rotate_4.Geometry, Motion=unit_z_2)  # -> Geometry, Transform
replace_items = ReplaceItems(List=repeat_data, Item="True", Indices=expr("x-1", steps_division), Wrap=False)
shift_list = ShiftList(List=move_7.Geometry, Shift=1, Wrap=invert(True))
cull_pattern = CullPattern(List=shift_list, CullPattern=replace_items)
extend_curve = ExtendCurve(Curve=cull_pattern, Type=0, Start="10", End="10")
pipe = Pipe(Curve=extend_curve, Radius=expr("x/2", gap), Caps=1)
shift_paths = ShiftPaths(Data=pipe, Offset=-1)
entwine_2 = Entwine(Branch00=loft, Branch01=loft_2, FlattenInputs=True)
split_brep_multiple = SplitBrepMultiple(Brep=entwine_2, Cutters=shift_paths)

# ---- group: steps / full tread
brep_join = BrepJoin(Breps=extrude)  # -> Breps, Closed

# ---- group: steps (continued)
rotate_5 = Rotate(Geometry=brep_join.Breps, Angle=degrees(series_2), Plane=PlaneXY(0, 0, 0))  # -> Geometry, Transform

# ----
division_2 = Division(A=radius_of_handrail, B="2")
division_3 = Division(A=radius_of_handrail_support, B="2")
unit_z_9 = UnitZ(Factor=height_of_handrail)
entwine_3 = Entwine(Branch00=move_4.Geometry, Branch01=move_6.Geometry, FlattenInputs=True)  # -> graft(Result)
offset_from_glass = Slider(4, range=0..10)
move_8 = Move(Geometry=entwine_3, Motion=unit_z_9)  # -> Geometry, Transform
negative_4 = Negative(Value=offset_from_glass)
split_tree = SplitTree(Data=move_8.Geometry, Masks=flatten("{0;0;0}"))  # -> Positive, Negative
shift_paths_2 = ShiftPaths(Data=pipe, Offset=-1)
split_with_breps = SplitWithBreps(Curve=move_8.Geometry, Brep=shift_paths_2)  # -> Curve, Points
offset_curve = OffsetCurve(Curve=split_tree.Positive, Distance=offset_from_glass, Plane=PlaneXY(0, 0, 0), Corners=1)
offset_curve_2 = OffsetCurve(Curve=split_tree.Negative, Distance=negative_4, Plane=PlaneXY(0, 0, 0), Corners=1)
panel = Panel("""True
False""")
pipe_2 = Pipe(Curve=offset_curve, Radius=division_2, Caps="1")
pipe_3 = Pipe(Curve=offset_curve_2, Radius=division_2, Caps="1")
cull_pattern_2 = CullPattern(List=split_with_breps.Curve, CullPattern=panel)
split_tree_2 = SplitTree(Data=cull_pattern_2, Masks=flatten("{0;0;0;0}"))  # -> Positive, Negative
offset_curve_3 = OffsetCurve(Curve=split_tree_2.Positive, Distance=offset_from_glass, Plane=PlaneXY(0, 0, 0), Corners=1)
offset_curve_4 = OffsetCurve(Curve=split_tree_2.Negative, Distance=negative_4, Plane=PlaneXY(0, 0, 0), Corners=1)
curve = Curve(cull_pattern_2)
curve_middle = CurveMiddle(Curve=curve)
curve_2 = Curve([offset_curve_4, offset_curve_3])
curve_middle_2 = CurveMiddle(Curve=curve_2)
graft_tree = GraftTree(Tree=curve_middle, IncludeEmptyLists=True, IncludeNullItems=True)
line_4 = Line(StartPoint=graft_tree, EndPoint=curve_middle_2)
pipe_4 = Pipe(Curve=line_4, Radius=division_3, Caps=0)
flip_curve = FlipCurve(Curve=line_4)  # -> Curve, Flag
addition_5 = Addition(A=balustrade_glass_thickness, B="1.5")
negative_5 = Negative(Value=addition_5)
extend_curve_2 = ExtendCurve(Curve=flip_curve.Curve, Type=0, Start=negative_5, End=balustrade_glass_thickness)
division_4 = Division(A=division_3, B="2")
pipe_5 = Pipe(Curve=extend_curve_2, Radius=division_4, Caps=0)
perp_frame = PerpFrame(Curve=reparameterize(extend_curve_2), Parameter=Slider(1, range=0.1..1))
circle_3 = Circle(Plane=perp_frame, Radius=radius_of_handrail_support_bracket)
plate_thickness = Slider(1.25, range=0.1..4)

discontinuity = Discontinuity(Curve=split_brep_multiple, Level=1)  # -> Points, Parameters
deconstruct = Deconstruct(Point=discontinuity.Points)  # -> XComponent, YComponent, ZComponent
sort_list = SortList(Keys=deconstruct.ZComponent, ValuesValuesA=discontinuity.Points)  # -> Keys, ValuesValuesA
list_item = ListItem(List=reverse(sort_list.ValuesValuesA), Index=0, Wrap=True)
shift_paths_3 = ShiftPaths(Data=list_item, Offset=-1)
deconstruct_2 = Deconstruct(Point=shift_paths_3)  # -> XComponent, YComponent, ZComponent
sort_list_2 = SortList(Keys=deconstruct_2.ZComponent, ValuesValuesA=split_brep_multiple)  # -> Keys, ValuesValuesA
cull_pattern_3 = CullPattern(List=sort_list_2.ValuesValuesA, CullPattern=[True, False])
negative_6 = Negative(Value=balustrade_glass_thickness)
graft_tree_2 = GraftTree(Tree=cull_pattern_3, IncludeEmptyLists=True, IncludeNullItems=True)
entwine_4 = Entwine(Branch00=negative_6, Branch01=balustrade_glass_thickness, FlattenInputs=True)
offset_surface = OffsetSurface(Surface=cull_pattern_3, Distance=entwine_4, Retrim=True)  # -> graft(Surface)
loft_3 = Loft(
    Curves=[offset_surface, graft_tree_2],
    Options={Adjust=False, Closed=False, LoftEnds=0, LoftSimp=0, LoftType=0, Rebuild=10, Refit=0.01})
brep_join_2 = BrepJoin(Breps=[offset_surface, loft_3, graft_tree_2])  # -> Breps, Closed

amplitude = Amplitude(Vector=circle_3, Amplitude=plate_thickness)
boundary_surfaces_2 = BoundarySurfaces(Edges=circle_3)
extrude_2 = Extrude(Base=boundary_surfaces_2, Direction=amplitude)
shift_paths_4 = ShiftPaths(Data=brep_join_2.Breps, Offset=-1)

# ---- group: treads
move_9 = Move(Geometry=rotate_5.Geometry, Motion=unit_z_2)  # -> Geometry, Transform

# ----
solid_union = SolidUnion(Breps=[pipe_4, pipe_2, pipe_3, extrude_2, pipe_5])
handrail = ClusterOutput(solid_union)
balustrade = ClusterOutput(shift_paths_4)
staircase_treads = ClusterOutput(move_9.Geometry)
colorj = ColorfulJitter(geometry=shift_paths_4, jitter=0, seed=2)
custom_preview = CustomPreview(Geometry=solid_union, Material=ColourSwatch(SwatchColor=RGB(184, 92, 92)))
custom_preview_2 = CustomPreview(Geometry=move_9.Geometry, Material=ColourSwatch(SwatchColor=RGB(126, 102, 186)))

rectangle = Rectangle(Plane=PlaneXY(0, 0, 0), XSize=number_slider, YSize=Slider(4, range=0.1..6), Radius=0)  # -> Rectangle, Length
rectangle_2 = Rectangle(Plane=PlaneXY(0, 0, 0), XSize=number_slider, YSize=Slider(4, range=0.1..6), Radius=Slider(4, range=0.1..6))  # -> Rectangle, Length
deconstruct_brep = DeconstructBrep(Brep=rectangle_2.Rectangle)  # -> Faces, Edges, Vertices
list_item_2 = ListItem(List=deconstruct_brep.Edges, Index=Slider(0, range=0..10), Wrap=True)
list_item_3 = ListItem(List=deconstruct_brep.Edges, Index=Slider(3, range=0..10), Wrap=True)
curve_middle_3 = CurveMiddle(Curve=list_item_2)
curve_middle_4 = CurveMiddle(Curve=list_item_3)
line_5 = Line(StartPoint=curve_middle_3, EndPoint=curve_middle_4)
unit_z_10 = UnitZ(Factor=1)
extrude_3 = Extrude(Base=line_5, Direction=unit_z_10)
split_brep = SplitBrep(Brep=rectangle.Rectangle, Cutter=extrude_3)
split_brep_2 = SplitBrep(Brep=rectangle_2.Rectangle, Cutter=extrude_3)
list_item_4 = ListItem(List=split_brep_2, Index=Slider(1, range=0..1), Wrap=True)
list_item_5 = ListItem(List=split_brep, Index=Slider(0, range=0..1), Wrap=True)
plate_thickness_2 = Slider(1.25, range=0..10)
brep_join_3 = BrepJoin(Breps=[list_item_5, list_item_4])  # -> Breps, Closed
unit_z_11 = UnitZ(Factor=plate_thickness_2)
bracket_1 = Extrude(Base=brep_join_3.Breps, Direction=unit_z_11)
deconstruct_brep_2 = DeconstructBrep(Brep=bracket_1)  # -> Faces, Edges, Vertices
unit_z_12 = UnitZ(Factor=tread_thickness)
list_item_6 = ListItem(List=deconstruct_brep_2.Edges, Index=Slider(7, range=0..30), Wrap=True)
unit_x = UnitX(Factor=plate_thickness_2)
extrude_4 = Extrude(Base=list_item_6, Direction=unit_z_12)
negative_7 = Negative(Value=unit_x)
bracket_2 = Extrude(Base=extrude_4, Direction=negative_7)
area = Area(Geometry=extrude_4)  # -> Area, Centroid
deconstruct_brep_3 = DeconstructBrep(Brep=bracket_2)  # -> Faces, Edges, Vertices
area_2 = Area(Geometry=bracket_2)  # -> Area, Centroid
multiplication = Multiplication(A=plate_thickness_2, B="2")
plane_surface = PlaneSurface(Plane=area_2.Centroid, XSize=Domain(-10, 10), YSize=Domain(-10, 10))
yz_plane = YZPlane(Origin=area.Centroid)
list_item_7 = ListItem(List=deconstruct_brep_3.Faces, Index=Slider(5, range=0..20), Wrap=True)
bracket_3 = Mirror(Geometry=bracket_1, Plane=plane_surface)  # -> Geometry, Transform
division_5 = Division(A=offset_from_stair, B="2")
circle_4 = Circle(Plane=yz_plane, Radius=multiplication)
division_6 = Division(A=multiplication, B="2")
addition_6 = Addition(A=balustrade_glass_thickness, B=plate_thickness_2)
boundary_surfaces_3 = BoundarySurfaces(Edges=circle_4)
amplitude_2 = Amplitude(Vector=circle_4, Amplitude=division_5)
addition_7 = Addition(A=balustrade_glass_thickness, B="1.25")
amplitude_3 = Amplitude(Vector=amplitude_2, Amplitude=addition_7)
bracket_4 = Extrude(Base=boundary_surfaces_3, Direction=amplitude_2)
bracket_5 = Move(Geometry=bracket_4, Motion=amplitude_3)  # -> Geometry, Transform

circle_5 = Circle(Plane=yz_plane, Radius=division_6)
boundary_surfaces_4 = BoundarySurfaces(Edges=circle_5)
amplitude_4 = Amplitude(Vector=circle_4, Amplitude=addition_6)
bracket_4_2 = Extrude(Base=boundary_surfaces_4, Direction=amplitude_4)

brep = Brep([bracket_5.Geometry, bracket_4, bracket_3.Geometry, bracket_2, bracket_1, bracket_4_2])
mirror = Mirror(Geometry=brep, Plane=list_item_7)  # -> Geometry, Transform

# ---- group: bracket orientation
deconstruct_brep_4 = DeconstructBrep(Brep=brep_join.Breps)  # -> Faces, Edges, Vertices
deconstruct_brep_5 = DeconstructBrep(Brep=brep_join.Breps)  # -> Faces, Edges, Vertices
md_slider = MDSlider(SliderMode=0, slider_value=Point(0.5, 0.5, 0.5), x_domain=Domain(0, 1), y_domain=Domain(0, 1), z_domain=Domain(0, 1))
md_slider_2 = MDSlider(
    SliderMode=0,
    slider_value=Point(0.5, 0.6646341463, 0.5),
    x_domain=Domain(0, 1),
    y_domain=Domain(0, 1),
    z_domain=Domain(0, 1))
list_item_8 = ListItem(List=deconstruct_brep_5.Faces, Index=Slider(3, range=1..6), Wrap=True)
list_item_9 = ListItem(List=deconstruct_brep_4.Faces, Index=Slider(1, range=1..6), Wrap=True)
md_slider_3 = MDSlider(SliderMode=0, slider_value=Point(0.5, 0.5, 0.5), x_domain=Domain(0, 1), y_domain=Domain(0, 1), z_domain=Domain(0, 1))
evaluate_surface = EvaluateSurface(Surface=reparameterize(list_item_7), Point=md_slider)  # -> Point, Normal, UDirection, VDirection, Frame
md_slider_4 = MDSlider(
    SliderMode=0,
    slider_value=Point(0.5, 0.3292682927, 0.5),
    x_domain=Domain(0, 1),
    y_domain=Domain(0, 1),
    z_domain=Domain(0, 1))
surface = Surface(list_item_8)
surface_2 = Surface(list_item_9)
evaluate_surface_2 = EvaluateSurface(Surface=reparameterize(surface), Point=md_slider_3)  # -> Point, Normal, UDirection, VDirection, Frame
evaluate_surface_3 = EvaluateSurface(Surface=reparameterize(surface_2), Point=[md_slider_4, md_slider_2])  # -> Point, Normal, UDirection, VDirection, Frame
orient = Orient(
    Geometry=graft(mirror.Geometry),
    Source=evaluate_surface.Frame,
    Target=[evaluate_surface_3.Frame, evaluate_surface_2.Frame])  # -> Geometry, Transform
brep_2 = Brep(graft(orient.Geometry))
rotate_6 = Rotate(Geometry=brep_2, Angle=degrees(series_2), Plane=PlaneXY(0, 0, 0))  # -> Geometry, Transform

# ---- group: brackets
move_10 = Move(Geometry=rotate_6.Geometry, Motion=unit_z_2)  # -> Geometry, Transform

# ----
brackets = ClusterOutput(move_10.Geometry)
custom_preview_3 = CustomPreview(Geometry=move_10.Geometry, Material=ColourSwatch(SwatchColor=RGB(61, 61, 61)))

# ==== cluster ColorfulJitter: Derived from 'Colourful' (by HS Kim?) 12/18/2020
geometry = ClusterInput()
jitter = ClusterInput()
seed = ClusterInput()
geometry_2 = Geometry(geometry)
clean_tree = CleanTree(RemoveNulls=True, RemoveInvalid=True, RemoveEmpty=False, Tree=geometry_2)
list_length = ListLength(List=clean_tree)
range = Range(Domain=Domain(0, 0.9), Steps=expr("x-1", list_length))
combine_data = CombineData(Input0=range, Input1="0")  # -> Result, Index
colour_hsl = ColourHSL(Alpha=1, Hue=combine_data.Result, Saturation=1, Luminance=0.5)
jitter_2 = Jitter(List=colour_hsl, Jitter=jitter, Seed=seed)  # -> Values, Indices
custom_preview = CustomPreview(Geometry=clean_tree, Shader=jitter_2.Values)
